# Grasshopper definition voronoi_corridor.gh (Grasshopper 1.0.8)

point_count = Slider(25, range=0..100)
brep = Brep(<brep referenced from the Rhino model>)
divisions_for_cutting = Slider(5, range=0..50)
area = Area(Geometry=brep)  # -> Area, Centroid
popgeo = PopulateGeometry(Geometry=brep, Count=point_count, Seed=2)
scale = Scale(Geometry=brep, Center=area.Centroid, Factor=2)  # -> Geometry, Transform
popgeo_2 = PopulateGeometry(Geometry=brep, Count=point_count, Seed=1)
divide = DivideDomain²(Domain=brep, UCount=divisions_for_cutting, VCount=divisions_for_cutting)
voronoi³ = Voronoi3D(Points=popgeo_2, Box=scale.Geometry)  # -> Cells, Boundary
volume = Volume(Geometry=voronoi³.Cells)  # -> Volume, Centroid
subsrf = Isotrim(Surface=brep, Domain=divide)
scale_2 = Scale(Geometry=voronoi³.Cells, Center=volume.Centroid, Factor=0.8)  # -> Geometry, Transform
trim = TrimSolid(Shape=brep, Cutters=scale_2.Geometry)
extrusion_thickness = Slider(-50, range=-100..0)
item = ListItem(List=trim, Index=0, Wrap=True)
splitmul = SplitBrepMultiple(Brep=item, Cutters=subsrf)
Z = UnitZ(Factor=extrusion_thickness)
debrep = DeconstructBrep(Brep=splitmul)  # -> Faces, Edges, Vertices
extr = Extrude(Base=splitmul, Direction=Z)
end = EndPoints(Curve=debrep.Edges)  # -> Start, End
ln = Line(StartPoint=end.Start, EndPoint=end.End)
dims = LinearDimension(Line=ln, PointA=end.Start, PointB=end.End, Text="{0:0}", Size=20)
